% Simulink data dictionary VehicleModelDictionary.sldd

mw = 0.064
Iw = 2.78742e-5
rw = 0.032
bw = 0.01
mb = 0.5
Ib = 0.00290817
l = 0.06
g = 9.80665
VehicleContactForce = struct(kw=100000, w_offset=0.005)
QuadratureEncoder = struct(PPR=12, ResolutionMult=4)
MotorParameters = struct(gearRatio=34, tau=0.005)

ltiSys = ss(
  a=[0 0 1 0; 0 0 0 1; 0 -3.815731 -39.75546 0; 0 86.80049 253.3179 0],
  b=[0 0; 0 0; 76.57861 -12.96988; -700.3482 295.0395],
  c=[1 0 0 0; 0 1 0 0; 0 0 1 0; 0 0 0 1],
  d=repmat(0, 4, 2),
  Ts=0)

lqgController = struct(K=[-0.765 -0.6428011 -0.330356 -0.1097904])