% Simulink data dictionary VehicleParametersDictionary.sldd

mw = 0.064
Iw = 2.78742e-5
rw = 0.032
bw = 0.01
mb = 0.5
Ib = 0.00290817
l = 0.06
g = 9.80665
VehicleContactForce = struct(kw=100000, w_offset=0.005)
QuadratureEncoder = struct(PPR=12, ResolutionMult=4)
MotorParameters = struct(gearRatio=34, tau=0.005)